# Dynamo graph SteelTakeOff.dyn "hamotSteelTakeOff" (Dynamo 2.1.0.7500)

categories = Categories("OST_StructuralFraming")
all_elements_of_category = ElementsOfCategory(Category=categories)
code_block = CodeBlock { "Comments"; }
getParameterValueByName = Element.GetParameterValueByName(element=all_elements_of_category, parameterName=code_block)
code_block_2 = CodeBlock { "Type"; }
getParameterValueByName_2 = Element.GetParameterValueByName(element=all_elements_of_category, parameterName=code_block_2)
code_block_3 = CodeBlock { "Cut Length"; }
getParameterValueByName_3 = Element.GetParameterValueByName(element=all_elements_of_category, parameterName=code_block_3)
list_create = List.Create(item0=getParameterValueByName, item1=getParameterValueByName_2, item2=getParameterValueByName_3)
transpose = List.Transpose(lists=list_create)

# group: Excel Import
file_path = Filename(".\steelTakeOff-Framing.xlsx")
string = StringInput("Sheet 1")
number = DoubleInput(0)
boolean = BoolSelector(true)
exportExcel = Data.ExportExcel(filePath=file_path, sheetName=string, startRow=number, startCol=number, data=transpose, overWrite=boolean)

file_path_2 = Filename(".\steelTakeOff-Columns.xlsx")
string_2 = StringInput("Sheet 1")
number_2 = DoubleInput(0)
categories_2 = Categories("OST_ColumnAnalytical")
all_elements_of_category_2 = ElementsOfCategory(Category=categories_2)
code_block_4 = CodeBlock { "Comments"; }
getParameterValueByName_4 = Element.GetParameterValueByName(element=all_elements_of_category_2, parameterName=code_block_4)
code_block_5 = CodeBlock { "Family Type"; }
getParameterValueByName_5 = Element.GetParameterValueByName(element=all_elements_of_category_2, parameterName=code_block_5)
code_block_6 = CodeBlock { "Length"; }
getParameterValueByName_6 = Element.GetParameterValueByName(element=all_elements_of_category_2, parameterName=code_block_6)
list_create_2 = List.Create(item0=getParameterValueByName_4, item1=getParameterValueByName_5, item2=getParameterValueByName_6)
transpose_2 = List.Transpose(lists=list_create_2)
boolean_2 = BoolSelector(true)
exportExcel_2 = Data.ExportExcel(filePath=file_path_2, sheetName=string_2, startRow=number_2, startCol=number_2, data=transpose_2, overWrite=boolean_2)
